# Grasshopper definition ThesisBuildingGeneratorPublish.gh (Grasshopper 1.0.8)
# plug-ins: Pufferfish

buildingprobableprojected = Curve([<curve referenced from the Rhino model> x385])  # disabled
buildingpossibleprojected = Curve([<curve referenced from the Rhino model> x558])  # disabled
buildingexcprojected = Curve([<curve referenced from the Rhino model> x15])  # disabled
buildingprobable2d = Curve([<curve referenced from the Rhino model> x385])  # disabled
buildingpossible2d = Curve([<curve referenced from the Rhino model> x558])  # disabled
partitionexcavation = Curve([<curve referenced from the Rhino model> x7])
bastionbuilding5 = Curve([<curve referenced from the Rhino model> x14])
bastionbuilding6 = Curve([<curve referenced from the Rhino model> x4])
bastionbuilding3 = Curve([<curve referenced from the Rhino model> x18])
buildingext2d = Curve([<curve referenced from the Rhino model> x15])  # disabled
# MudWallParameters
list = ValueList({"Sharp": 0, "Round": 1, "Smooth": 2, "Chamfer": 3}, selected="Sharp")
# DoorParameters
number_slider = Slider(0.4, range=0..1)
doorthickness = Slider(0.03, range=0..0.1)
doorheight = Panel("1.8")
doorsill_height = Slider(-0.2, range=-1..0)
# RoofParameters
eavedistance = Slider(0.3, range=0..1)
roofthickness = Slider(0.3, range=0..1)
roofpitchdegrees = ControlKnob(Decimals=1, Limit=True, Maximum=20, Minimum=0, Range=90, Value=4)
beamradius = Panel(".1")
maxbeamseperation = Panel("0.8")
# FoundationParameters
abovegroundheight = Slider(0.4, range=0..10)
substructurewidth = Panel("0.569")
randomwidthaddtionmax = Slider(0, range=0..1)
mudbrickwidth = Panel(".56")
mudbrickwallwidth = Slider(0.32, range=0..1)
mudbrickabovegroundheight = Slider(2, range=0..10)
randomheightaddtion = Slider(0, range=0..1)
# FloorParameters
randomwidthaddtionmax_2 = Slider(0, range=0..1)
flooroffset = Slider(0.1, range=0..1)
# WindowParameters
windowsegmentmin = Slider(3.2, range=0..10)
lintelextension = Slider(0.2, range=0..1)
lintelexpression = Slider(0.05, range=0..1)
minwindowheight = Slider(0.5, range=0..1)
maxwindowheight = Slider(0.9, range=0..10)
# BeamParameters
perecentageofroofswithrocks = Slider(32, range=0..100)
randomheightaddtion_2 = Slider(0, range=0..1)
lintelheight = Slider(0.2, range=0..1)
polylinesprojected = Curve(buildingpossibleprojected)
# RockParameters
rockmeshcollection = Mesh([<mesh referenced from the Rhino model> x6])
rad = Radians(Degrees=roofpitchdegrees)
mudbrickwidth_2 = Number(expr("x/2", mudbrickwidth))
num = Number(substructurewidth)

# ----
# Make curve direction
# uniform for all
polygon = Polygon(Plane=PlaneXY(0, 0, 0), Radius=3, Segments=6, FilletRadius=0)  # -> Polygon, Length
simplify = SimplifyCurve(Curve=polylinesprojected)  # -> Curve, Simplified
flip = FlipCurve(Curve=simplify.Curve, Guide=polygon.Polygon)  # -> Curve, Flag

Z = UnitZ(Factor=mudbrickabovegroundheight)
rev = Reverse(Vector=Z)
buildingpossible2d_2 = Curve(buildingpossible2d)

# ----
# Substructure Generator
# SUBSTRUCTURE
# sub algorithm
randomwidthaddtionmax_3 = Number(randomwidthaddtionmax)
randomheightaddtion_3 = Number(randomheightaddtion_2)
abovegroundmax = Number(abovegroundheight)
projectedcurve = Curve(flip.Curve)
wallthickness = Number(num)
flooroffset_2 = Number(flooroffset)
_2dcurve = Curve(buildingpossible2d)
corner = Integer(list)

# ----
# Step 3 find extremities
# Find the highest and lowest points
x_tremez = Extremes(Curve=projectedcurve, Plane=PlaneXY(0, 0, 0))  # -> Highest, Lowest

# ----
# Get distance between highest and lowest point
pdecon = Deconstruct(Point=x_tremez.Lowest)  # -> XComponent, YComponent, ZComponent
pdecon_2 = Deconstruct(Point=x_tremez.Highest)  # -> XComponent, YComponent, ZComponent
subtraction = Subtraction(A=pdecon_2.ZComponent, B=pdecon.ZComponent)

# ----
# Thicknesses for boths sides of the wall
division = Division(A=wallthickness, B=2)
division_2 = Division(A=randomwidthaddtionmax_3, B=2)
random = Random(Range=division_2, Number=1, Seed=2)
addition = Addition(A=division, B=random)
neg = Negative(Value=addition)

# ----
# STEP 4
# create a plane at the lowest point
xy = XYPlane(Origin=x_tremez.Lowest)

# ----
# STEP 5
# Project the curve onto the new plane
project = Project(Geometry=projectedcurve, Plane=xy)  # -> Geometry, Transform
simplify_2 = SimplifyCurve(Curve=project.Geometry)  # -> Curve, Simplified

# ----
# Tests if polylines are closed or not
clscrv = CloseCurve(Curve=simplify_2.Curve, CloseType=0, Bulge=0.5, Tolerance=0)  # -> Closed, R

# ----
# STEP 1
clscrv_2 = CloseCurve(Curve=buildingpossible2d_2, CloseType=0, Bulge=0.5, Tolerance=0)  # -> Closed, R
pcen = PolygonCenter(Polyline=clscrv_2.Closed)  # -> CenterV, CenterE, CenterA
Z_2 = UnitZ(Factor=1)

# ----
# STEP 1
num_2 = Number(substructurewidth)

# ----
# STEP 2
# move door sill up
num_3 = Number(doorsill_height)
dom = ConstructDomain(DomainStart=0, DomainEnd=num_3)

# ----
# STEP 3
panel = Panel("4")  # disabled
neg_2 = Negative(Value=panel)  # disabled
dom_2 = ConstructDomain(DomainStart=neg_2, DomainEnd=1)  # disabled

# ----
# Door Generator
# Create a door solid to boolean out later.  For performance this should be baked before booleaning.
# prep geometry
doorheight_2 = Number(doorheight)

# ----
# STEP 3
Z_3 = UnitZ(Factor=doorheight_2)
max = Maximum(A=num, B=num)
panel_2 = Panel(max)

# ----
# Sorts and seperates closed polylines for different workflow
lng = ListLength(List=simplify_2.Curve)
series = Series(Start=0, Step=1, Count=lng)
dispatch = Dispatch(List=simplify_2.Curve, DispatchPattern=clscrv.R)  # -> ListA, ListB
dispatch_2 = Dispatch(List=series, DispatchPattern=clscrv.R)  # -> ListA, ListB

# ----
# OPTIONAL
# PARAMETER
# VARIATION
# Add the random height and the height required above the highest point move the plane to that height
random_2 = Random(Range=randomheightaddtion_3, Number=lng, Seed=2)
addition_2 = Addition(A=subtraction, B=abovegroundmax, C=random_2)

# ----
# STEP 6
# Adds the extremities to the substructure hight and takes away the floor offset to get the correct offest hight from the lowest point
# Creates the floor surface then moves it to the correct position
num_4 = Number(addition_2)
subtraction_2 = Subtraction(A=num_4, B=flooroffset_2)
Z_4 = UnitZ(Factor=subtraction_2)
move = Move(Geometry=clscrv.Closed, Motion=Z_4)  # -> Geometry, Transform
boundary = BoundarySurfaces(Edges=move.Geometry)

# ----
# STEP 7
# Add the random height and the height required above the highest point move the plane to that height
# Create a plane at the new top of wall and project the wall curve to it
Z_5 = UnitZ(Factor=addition_2)
move_2 = Move(Geometry=xy, Motion=Z_5)  # -> Geometry, Transform
xy_2 = XYPlane(Origin=move_2.Geometry)
projecta = ProjectAlong(Geometry=simplify_2.Curve, Plane=xy_2, Direction=Vector(0, 0, -1))  # -> Geometry, Transform

dispatch_3 = Dispatch(List=Z_5, DispatchPattern=clscrv.R)  # -> ListA, ListB
dispatch_4 = Dispatch(List=xy_2, DispatchPattern=clscrv.R)  # -> ListA, ListB

# ----
# STEP 8
# Offset open polyline Curves in both directions
offcrv = OffsetCurve(Curve=dispatch.ListB, Plane=dispatch_4.ListB, Distance=neg, BothSides=0, Kinks=corner, CapType=1)
offcrv_2 = OffsetCurve(Curve=dispatch.ListB, Plane=dispatch_4.ListB, Distance=addition, BothSides=0, Kinks=corner, CapType=1)

# ----
# STEP 8a
# Offset open polyline Curves in both directions
offset = OffsetCurve(Curve=dispatch.ListA, Distance=expr("x*-1", division), Plane=dispatch_4.ListA, Corners=1)
offset_2 = OffsetCurve(Curve=dispatch.ListA, Distance=division, Plane=dispatch_4.ListA, Corners=1)

# ----
# Connects the offsets with lines at their ends to create a continual outline
end = EndPoints(Curve=offset_2)  # -> Start, End
end_2 = EndPoints(Curve=offset)  # -> Start, End
ln = Line(StartPoint=end.Start, EndPoint=end_2.Start)
ln_2 = Line(StartPoint=end_2.End, EndPoint=end.End)
join = JoinCurves(Curves=[ln, ln_2, offset], Preserve=False)

# ----
# STEP 9
# Extrude the projected curve downwards through the ground
extr = Extrude(Base=offcrv, Direction=graft(dispatch_3.ListB))
extr_2 = Extrude(Base=offcrv_2, Direction=graft(dispatch_3.ListB))

# ----
# STEP 10
# Create stonewall top from offset outlines
move_3 = Move(Geometry=[offcrv, offcrv_2], Motion=graft(dispatch_3.ListB))  # -> Geometry, Transform
boundary_2 = BoundarySurfaces(Edges=move_3.Geometry)

# ----
# STEP 10a
# Create stonewall top from offset outlines
join_2 = JoinCurves(Curves=flatten([join, offset_2]), Preserve=False)
move_4 = Move(Geometry=join_2, Motion=dispatch_3.ListA)  # -> Geometry, Transform
py3 = Python3Script(x=move_4.Geometry)  # -> out, a; inputs x: Curve
# ---------- py3: Python ----------
import rhinoscriptsyntax as rs
import Rhino.Geometry as rg

srf = None

try:
    if x is not None:
        # Convert to Rhino curve geometry
        crv = x
        if hasattr(x, 'ToGeometry'):
            crv = x.ToGeometry()
        
        # Ensure the curve is closed
        if not crv.IsClosed:
            crv = rg.Curve.JoinCurves([crv, rg.Line(crv.PointAtEnd, crv.PointAtStart).ToNurbsCurve()])[0]
        
        # Try to create a planar surface from the closed curve
        breps = rg.Brep.CreatePlanarBreps(crv, 0.001)
        
        if breps and len(breps) > 0:
            srf = breps[0]

except Exception as e:
    srf = None

a = srf
# ---------- end py3 ----------

# ----
# STEP 9a
# Extrude the projected curve downwards through the ground
# create solids from offsets
py3_2 = Python3Script(x=join_2)  # -> out, a; inputs x: Curve; same code as py3
extr_3 = Extrude(Base=offset_2, Direction=graft(dispatch_3.ListA))
extr_4 = Extrude(Base=join, Direction=graft(dispatch_3.ListA))
join_3 = BrepJoin(Breps=py3_2.a)  # -> Breps, Closed; disabled

# ----
# STEP 11
# Resort open and closed polyline surfaces
merge = Merge(Data1=flatten(dispatch_2.ListA), Data2=flatten(dispatch_2.ListB))
merge_2 = Merge(Data1=flatten(py3.a), Data2=flatten(boundary_2))
sort = SortList(Keys=merge, ValuesA=merge_2)  # -> Keys, ValuesA

# ----
# STEP 12
stonewalltop = Brep(sort.ValuesA)
stonewallext = Brep([extr_2, extr_3])
floorsurface = Brep(boundary)
stonewallint = Brep([extr, extr_4])
planes = Plane(graft(xy_2))
watertight = Brep(join_3.Breps)
crv = Curve(projecta.Geometry)

crv_2 = Curve(crv)

crv_3 = Curve(crv_2)
explode = Explode(Curve=crv_3, Recursive=True)  # -> Segments, Vertices
item = ListItem(List=explode.Segments, Index="0", Wrap=True)
py3_3 = Python3Script(Line=item, WallThick=num_2, DoorOffset="0.2", DoorWidth="0.8")  # -> out, DoorLine, DoorOkList; inputs Line: Line, WallThick: Double, DoorOffset: Double, DoorWidth: Double
# ---------- py3_3: Python ----------
import rhinoscriptsyntax as rs
import Rhino.Geometry as rg

# Measure the line length
lineLength = Line.Length

# Minimum required length
minLength = (2 * WallThick) + (2 * DoorOffset) + DoorWidth

# Check if the line is long enough
if lineLength > minLength:
    doorOk = True
    
    # Get the start point and direction of the line
    startPt = Line.From
    direction = Line.Direction
    direction.Unitize()
    
    # Calculate start of door line
    doorStart = startPt + direction * (WallThick + DoorOffset)
    
    # Calculate end of door line
    doorEnd = doorStart + direction * DoorWidth
    
    # Create the door line
    DoorLine = rg.Line(doorStart, doorEnd)

else:
    doorOk = False
    DoorLine = None

# Append to doorOk list
doorOkList = [doorOk]
# ---------- end py3_3 ----------
pln = Plane(planes)
projecta_2 = ProjectAlong(Geometry=py3_3.DoorLine, Plane=pln, Direction=Vector(0, 0, -1))  # -> Geometry, Transform

# ----
# randomly split floors into two types
brep = Brep(floorsurface)
lng_2 = ListLength(List=flatten(brep))
py3_4 = Python3Script(count=lng_2)  # -> out, a; inputs count: Int32
# ---------- py3_4: Python ----------
import random

# count: integer input specifying output list length

if count is None or count <= 0:
    a = []
else:
    a = [random.choice([True, False]) for _ in range(count)]
# ---------- end py3_4 ----------
dispatch_5 = Dispatch(List=brep, DispatchPattern=py3_4.a)  # -> ListA, ListB

lng_3 = ListLength(List=crv_3)
random_3 = Random(Range=dom, Number=lng_3, Seed=2)
Z_6 = UnitZ(Factor=random_3)
doorcurves = Curve(projecta_2.Geometry)
move_5 = Move(Geometry=doorcurves, Motion=graft(Z_6))  # -> Geometry, Transform

extr_5 = Extrude(Base=move_5.Geometry, Direction=Z_3)
pln_2 = Plane(extr_5)
unit = UnitVector(Vector=pln_2)
amp = Amplitude(Vector=unit, Amplitude=expr("x/2+.1", panel_2))
move_6 = Move(Geometry=extr_5, Motion=amp)  # -> Geometry, Transform
rev_2 = Reverse(Vector=amp)
extr_6 = Extrude(Base=move_6.Geometry, Direction=expr("x*2", rev_2))
brep_2 = Brep(extr_6)
clean = CleanTree(RemoveNulls=True, RemoveInvalid=True, RemoveEmpty=False, Tree=brep_2)

# ----
# door Creation
amp_2 = Amplitude(Vector=unit, Amplitude=expr("x/2", doorthickness))  # disabled
rev_3 = Reverse(Vector=amp_2)  # disabled
move_7 = Move(Geometry=extr_5, Motion=amp_2)  # -> Geometry, Transform; disabled
extr_7 = Extrude(Base=move_7.Geometry, Direction=expr("x*2", rev_3))  # disabled

# ----
# STEP 4
# boolean solid creation
unit_2 = UnitVector(Vector=extr_5)
amp_3 = Amplitude(Vector=unit_2, Amplitude=expr("x/2", num_2))
neg_3 = Negative(Value=random_3)
move_8 = Move(Geometry=move_5.Geometry, Motion=amp_3)  # -> Geometry, Transform
end_3 = EndPoints(Curve=move_8.Geometry)  # -> Start, End
line = LineSDL(Start=[end_3.Start, end_3.End], Direction=Vector(0, 0, 1), Length=graft(neg_3))
join_4 = JoinCurves(Curves=[move_8.Geometry, line], Preserve=False)
amp_4 = Amplitude(Vector=unit_2, Amplitude=num_2)
extr_8 = Extrude(Base=join_4, Direction=expr("x*-1", amp_4))

# ----
# STEP 5
num_5 = Number(mudbrickwidth)
Z_7 = UnitZ(Factor=doorheight_2)
unit_3 = UnitVector(Vector=extr_5)
move_9 = Move(Geometry=move_5.Geometry, Motion=Z_7)  # -> Geometry, Transform
amp_5 = Amplitude(Vector=unit_3, Amplitude=expr("x/2", num_5))
addition_3 = Addition(A=doorheight_2, B=random_3)
move_10 = Move(Geometry=move_9.Geometry, Motion=amp_5)  # -> Geometry, Transform
neg_4 = Negative(Value=addition_3)
end_4 = EndPoints(Curve=move_10.Geometry)  # -> Start, End
line_2 = LineSDL(Start=[end_4.Start, end_4.End], Direction=Vector(0, 0, 1), Length=graft(neg_4))
amp_6 = Amplitude(Vector=unit_3, Amplitude=num_5)
join_5 = JoinCurves(Curves=[move_10.Geometry, line_2], Preserve=False)
extr_9 = Extrude(Base=join_5, Direction=expr("x*-1", amp_6))

# ----
# STEP 6
join_6 = BrepJoin(Breps=[extr_9, extr_8])  # -> Breps, Closed

# ----
# Pre-baked Door booleans
brep_3 = Brep(clean)

doorframes = Brep(join_6.Breps)
floortype2 = Surface(dispatch_5.ListB)  # disabled
floortype1 = Surface(dispatch_5.ListA)  # disabled
doors = Brep(extr_7)  # disabled

# ----
# Mudwall Generator
# Thicken the walls and make Solid
# MUDWALLS
# sub algorithm
randomwidthaddtionmax_4 = Number(randomwidthaddtionmax_2)
randomheightaddtion_4 = Number(randomheightaddtion)
abovegroundmax_2 = Number(expr("x*2", mudbrickabovegroundheight))
projectedcurve_2 = Curve(crv)
wallthickness_2 = Number(mudbrickwidth)
planes_2 = Plane(planes)
division_3 = Division(A=randomwidthaddtionmax_4, B=2)
random_4 = Random(Range=randomheightaddtion_4, Number=1, Seed=2)
division_4 = Division(A=wallthickness_2, B=2)
random_5 = Random(Range=division_3, Number=1, Seed=2)
planes_3 = Plane(planes_2)

# ----
# Add the random height and the height required above the highest point move the plane to that height
addition_4 = Addition(B=abovegroundmax_2, C=random_4)
Z_8 = UnitZ(Factor=addition_4)

# ----
# Create a plane at the new top of wall and project the wall curve to it
planesrf = PlaneSurface(Plane=PlaneXY(0, 0, 0), XSize=Domain(-100, 100), YSize=Domain(-100, 100))  # disabled
projecta_3 = ProjectAlong(Geometry=graft(projectedcurve_2), Plane=planes_2, Direction=Vector(0, 0, -1))  # -> Geometry, Transform

# ----
# Thicknesses for boths sides of the wall
addition_5 = Addition(A=division_4, B=random_5)
neg_5 = Negative(Value=addition_5)

move_11 = Move(Geometry=projecta_3.Geometry, Motion=Z_8)  # -> Geometry, Transform
crv_4 = Curve(move_11.Geometry)

# ----
# Seperate closed and open polylines
clscrv_3 = CloseCurve(Curve=projecta_3.Geometry, CloseType=0, Bulge=0.5, Tolerance=0)  # -> Closed, R
dispatch_6 = Dispatch(List=projecta_3.Geometry, DispatchPattern=clscrv_3.R)  # -> ListA, ListB

# ----
# STEP 8
panel_3 = Panel("Offset the curves")
offcrv_3 = OffsetCurve(Curve=dispatch_6.ListB, Plane=planes_2, Distance=division_4, BothSides=expr("x*-1", division_4), Kinks=0, CapType=1)
offset_3 = OffsetCurve(Curve=dispatch_6.ListA, Distance=expr("x*-1", division_4), Corners=1)
offcrv_4 = OffsetCurve(Curve=dispatch_6.ListB, Plane=projecta_3.Geometry, Distance=neg_5, BothSides=0, Kinks=0, CapType=1)
offcrv_5 = OffsetCurve(Curve=dispatch_6.ListB, Plane=projecta_3.Geometry, Distance=addition_5, BothSides=0, Kinks=0, CapType=1)
offset_4 = OffsetCurve(Curve=dispatch_6.ListA, Distance=division_4, Corners=1)
offset_5 = OffsetCurve(Curve=dispatch_6.ListA, Distance=division_4, Corners=1)

# ----
# enclose the offset lines so they are one continous outline
end_5 = EndPoints(Curve=offset_5)  # -> Start, End
end_6 = EndPoints(Curve=offset_3)  # -> Start, End
ln_3 = Line(StartPoint=end_5.Start, EndPoint=end_6.Start)
ln_4 = Line(StartPoint=end_6.End, EndPoint=end_5.End)
join_7 = JoinCurves(Curves=[ln_3, ln_4, offset_3], Preserve=False)

# ----
# STEP 9
# Extrude the projected curve upwards from the top of the substructure
extr_10 = Extrude(Base=offset_5, Direction=graft(Z_8))
extr_11 = Extrude(Base=offcrv_4, Direction=graft(Z_8))
extr_12 = Extrude(Base=offcrv_3, Direction=graft(Z_8))
extr_13 = Extrude(Base=offcrv_5, Direction=graft(Z_8))
extr_14 = Extrude(Base=join_7, Direction=graft(Z_8))

# ----
# STEP 10
boundary_3 = BoundarySurfaces(Edges=[offcrv_4, offcrv_5, offcrv_3])
move_12 = Move(Geometry=boundary_3, Motion=Z_8)  # -> Geometry, Transform

# ----
# STEP 11
join_8 = BrepJoin(Breps=[extr_12, boundary_3, move_12.Geometry])  # -> Breps, Closed
join_9 = BrepJoin(Breps=[move_12.Geometry, extr_13, extr_11, boundary_3])  # -> Breps, Closed

# ----
# STEP 12
extwalloutline = Curve([offset_4, offcrv_5])
mudwalltop = Brep(move_12.Geometry)
mudwallext = Brep([extr_13, extr_10])
mudwallint = Brep([extr_11, extr_14])
watertight_2 = Brep(join_8.Breps)
crv_5 = Curve(crv_4)

move_13 = Move(Geometry=crv_5, Motion=rev)  # -> Geometry, Transform
polylinecurveattopofmudbrick = Curve(move_13.Geometry)

clscrv_4 = CloseCurve(Curve=polylinecurveattopofmudbrick, CloseType=0, Bulge=0.5, Tolerance=0)  # -> Closed, R
pcen_2 = PolygonCenter(Polyline=clscrv_4.Closed)  # -> CenterV, CenterE, CenterA
crv_cp = CurveClosestPoint(Point=graft(pcen.CenterV), Curve=clscrv_4.Closed)  # -> Point, Parameter, Distance
pl = ConstructPlane(Origin=pcen_2.CenterV, XAxis=Vector(1, 0, 0), YAxis=Vector(0, 1, 0))
vec2pt = Vector2Pt(PointA=pcen_2.CenterV, PointB=crv_cp.Point, Unitize=False)  # -> Vector, Length
xprod = CrossProduct(VectorA=vec2pt.Vector, VectorB=Z_2, Unitize=False)  # -> Vector, Length
unit_4 = UnitVector(Vector=vec2pt.Vector)
vdis = VectorDisplay(Anchor=pcen_2.CenterV, Vector=[Z_2, xprod.Vector, vec2pt.Vector])

# ----
# STEP 2
pl_2 = ConstructPlane(Origin=pl, XAxis=xprod.Vector, YAxis=unit_4)
rot3d = Rotate3D(Geometry=pl_2, Angle=rad, Center=pl_2, Axis=xprod.Vector)  # -> Geometry, Transform

# ----
# OUPUT FOR BOOLEANS
# IF REQUIRED
partitionwallsbake = Brep([watertight_2, stonewallext, stonewalltop, stonewallint])

planesrf_2 = PlaneSurface(Plane=rot3d.Geometry, XSize=dom_2, YSize=dom_2)  # disabled
project_2 = Project(Geometry=polylinecurveattopofmudbrick, Plane=planesrf_2)  # -> Geometry, Transform; disabled

brep_4 = Brep(mudwallint)
brep_5 = Brep(mudwallext)

# ----
# Roof Generator
# roof direction calculator
# Boolean for subtracting roof
# surface to
# project on
crv_6 = Curve(polylinecurveattopofmudbrick)
projecta_4 = ProjectAlong(Geometry=crv_6, Plane=rot3d.Geometry, Direction=Vector(0, 0, -1))  # -> Geometry, Transform
amp_7 = Amplitude(Vector=rot3d.Geometry, Amplitude=roofthickness)

clean_2 = CleanTree(RemoveNulls=True, RemoveInvalid=True, RemoveEmpty=False, Tree=projecta_4.Geometry)

# ----
# STEP 4
# height of Roof fall
x_tremez_2 = Extremes(Curve=clean_2, Plane=PlaneXY(0, 0, 0))  # -> Highest, Lowest
pdecon_3 = Deconstruct(Point=x_tremez_2.Lowest)  # -> XComponent, YComponent, ZComponent
pdecon_4 = Deconstruct(Point=x_tremez_2.Highest)  # -> XComponent, YComponent, ZComponent
subtraction_3 = Subtraction(A=pdecon_4.ZComponent, B=pdecon_3.ZComponent)
Z_9 = UnitZ(Factor=subtraction_3)
neg_6 = Negative(Value=Z_9)

# ----
# STEP 1
move_14 = Move(Geometry=rot3d.Geometry, Motion=neg_6)  # -> Geometry, Transform
projecta_5 = ProjectAlong(Geometry=extwalloutline, Plane=move_14.Geometry, Direction=Vector(0, 0, -1))  # -> Geometry, Transform
simplify_3 = SimplifyCurve(Curve=projecta_5.Geometry)  # -> Curve, Simplified

# ----
# STEP 2
explode_2 = Explode(Curve=simplify_3.Curve, Recursive=True)  # -> Segments, Vertices

# ----
# STEP 3
len = Length(Curve=explode_2.Segments)
py3_5 = Python3Script(Segments=explode_2.Segments, Lengths=len, Max=graft(windowsegmentmin))  # -> out, a, b; inputs Segments: list of Line, Lengths: list of Double, Max: Double
# ---------- py3_5: Python ----------
a = []
b = []

for L, S in zip(Lengths, Segments):
    if L is None:
        a.append(None)
        b.append(None)
    elif Max <= L < Max*2:
        a.append(S)
        b.append(None)
    elif L >= Max*2:
        a.append(None)
        b.append(S)
    else:
        a.append(None)
        b.append(None)
# ---------- end py3_5 ----------
clean_3 = CleanTree(RemoveNulls=True, RemoveInvalid=True, RemoveEmpty=False, Tree=py3_5.b)
# Window Generator
clean_4 = CleanTree(RemoveNulls=True, RemoveInvalid=True, RemoveEmpty=False, Tree=py3_5.a)

# ----
# STEP 4
divide = DivideCurve(Curve=clean_3, Count=7, Kinks=False)  # -> Points, Tangents, Parameters
divide_2 = DivideCurve(Curve=clean_4, Count=4, Kinks=False)  # -> Points, Tangents, Parameters
item_2 = ListItem(List=divide.Points, Index=2, Wrap=True)
item_3 = ListItem(List=divide.Points, Index=4, Wrap=True)
item_4 = ListItem(List=divide.Points, Index=1, Wrap=True)
item_5 = ListItem(List=divide.Points, Index=3, Wrap=True)
item_6 = ListItem(List=divide_2.Points, Index=2, Wrap=True)
item_7 = ListItem(List=divide_2.Points, Index=1, Wrap=True)
ln_5 = Line(StartPoint=item_5, EndPoint=item_3)
ln_6 = Line(StartPoint=item_7, EndPoint=item_6)
ln_7 = Line(StartPoint=item_4, EndPoint=item_2)
clean_5 = CleanTree(RemoveNulls=True, RemoveInvalid=True, RemoveEmpty=False, Tree=[ln_6, ln_7, ln_5])

# ----
# STEP 5
x_tremez_3 = Extremes(Curve=clean_5, Plane=PlaneXY(0, 0, 0))  # -> Highest, Lowest
xy_3 = XYPlane(Origin=x_tremez_3.Lowest)
projecta_6 = ProjectAlong(Geometry=clean_5, Plane=xy_3, Direction=Vector(0, 0, -1))  # -> Geometry, Transform

# ----
# STEP 6
# Creates Lintels
ext = ExtendCurve(Curve=projecta_6.Geometry, Type=0, Start=lintelextension, End=lintelextension)
num_6 = Number(num)
Z_10 = UnitZ(Factor=lintelheight)
offset_6 = OffsetCurve(Curve=ext, Distance=lintelexpression, Plane=projecta_5.Geometry, Corners=1)
extr_15 = Extrude(Base=offset_6, Direction=expr("x*-1", Z_10))
addition_6 = Addition(A=num_6)
unit_5 = UnitVector(Vector=extr_15)
amp_8 = Amplitude(Vector=unit_5, Amplitude=addition_6)
rev_4 = Reverse(Vector=amp_8)
extr_16 = Extrude(Base=extr_15, Direction=rev_4)

panel_4 = Panel(pdecon_4.ZComponent)

# ----
# STEP 5
move_15 = Move(Geometry=clean_2, Motion=neg_6)  # -> Geometry, Transform

# ----
# STEP 7
Z_11 = UnitZ(Factor=expr("X*-1", lintelheight))
move_16 = Move(Geometry=projecta_6.Geometry, Motion=Z_11)  # -> Geometry, Transform

# ----
# STEP 6
# Make curve direction
# uniform for all
flip_2 = FlipCurve(Curve=move_15.Geometry, Guide=polygon.Polygon)  # -> Curve, Flag
clscrv_5 = CloseCurve(Curve=flip_2.Curve, CloseType=0, Bulge=0.5, Tolerance=0)  # -> Closed, R

# ----
# STEP 8
# Window base Geometry
dom_3 = ConstructDomain(DomainStart=minwindowheight, DomainEnd=maxwindowheight)
lng_4 = ListLength(List=flatten(move_16.Geometry))
random_6 = Random(Range=dom_3, Number=lng_4, Seed=2)
Z_12 = UnitZ(Factor=expr("X*-1", random_6))
extr_17 = Extrude(Base=graft(move_16.Geometry), Direction=graft(Z_12))

# ----
# STEP 9
# Creates window booleans
unit_6 = UnitVector(Vector=extr_17)
mudwallwidth = Number(mudbrickwidth)
amp_9 = Amplitude(Vector=unit_6, Amplitude=mudwallwidth)
move_17 = Move(Geometry=extr_17, Motion=amp_9)  # -> Geometry, Transform
rev_5 = Reverse(Vector=amp_9)
extr_18 = Extrude(Base=move_17.Geometry, Direction=expr("x*3", rev_5))
clean_6 = CleanTree(RemoveNulls=True, RemoveInvalid=True, RemoveEmpty=False, Tree=extr_18)

# ----
# STEP 10
# Creates window Frames
edges = BrepEdges(Brep=extr_17)  # -> Naked, Interior, NonManifold
join_10 = JoinCurves(Curves=edges.Naked, Preserve=False)
amp_10 = Amplitude(Vector=unit_6, Amplitude=mudwallwidth)
rev_6 = Reverse(Vector=amp_10)
extr_19 = Extrude(Base=join_10, Direction=rev_6)
clean_7 = CleanTree(RemoveNulls=True, RemoveInvalid=True, RemoveEmpty=False, Tree=extr_19)

lintels = Mesh(extr_16)

# ----
# CRENELATIONS
Z_13 = UnitZ(Factor=roofthickness)

boundary_4 = BoundarySurfaces(Edges=clscrv_5.Closed)

srf = Surface(boundary_4)

# ----
# Beams
# STEP 1
sdivide = DivideSurface(Surface=srf, UCount=10, VCount=10)  # -> Points, Normals, Parameters
item_8 = ListItem(List=sdivide.Points, Index="10", Wrap=False)
item_9 = ListItem(List=sdivide.Points, Index="0", Wrap=False)

# ----
# STEP 2
trim = TrimTree(Tree=item_9, Depth=1)
trim_2 = TrimTree(Tree=item_8, Depth=1)

# ----
# STEP 3
py3_6 = Python3Script(SideA=trim_2, SideB=trim, MaxSeperation=maxbeamseperation)  # -> out, BeamLines; inputs SideA: list of Point3d, SideB: list of Point3d, MaxSeperation: Double
# ---------- py3_6: Python ----------
import math
import Rhino.Geometry as rg

# Guard against None inputs
if SideA is None or SideB is None or MaxSeperation is None:
    raise ValueError("SideA, SideB and MaxSeperation must all have values connected")

# Filter out any None items within the lists
ptsA = [rg.Point3d(p) for p in SideA if p is not None]
ptsB = [rg.Point3d(p) for p in SideB if p is not None]

# Bail out cleanly if filtering left too few points
if len(ptsA) < 2 or len(ptsB) < 2:
    BeamLines = []
else:
    # Measure distances between first and last points on each side
    distA = ptsA[0].DistanceTo(ptsA[-1])
    distB = ptsB[0].DistanceTo(ptsB[-1])

    # Use the longer distance to determine number of segments
    maxDist = max(distA, distB)

    # Calculate number of segments - minimum of 1 to avoid division by zero
    numSegments = max(1, int(math.ceil(maxDist / MaxSeperation)))
    numPoints = numSegments + 1

    # Build polylines through each point list
    curveA = rg.Polyline(ptsA).ToPolylineCurve()
    curveB = rg.Polyline(ptsB).ToPolylineCurve()

    if curveA is None or curveB is None:
        BeamLines = []
    else:
        # Sample equal number of points on each side
        pointsA = []
        pointsB = []
        for i in range(numPoints):
            t = i / float(numSegments)
            paramA = curveA.Domain.ParameterAt(t)
            paramB = curveB.Domain.ParameterAt(t)
            pointsA.append(curveA.PointAt(paramA))
            pointsB.append(curveB.PointAt(paramB))

        # Create lines between corresponding points
        BeamLines = []
        for i in range(numPoints):
            line = rg.Line(pointsA[i], pointsB[i])
            BeamLines.append(line)
# ---------- end py3_6 ----------

# ----
# STEP 4
panel_5 = Panel("1")
pipe = Pipe(Curve=py3_6.BeamLines, Radius=beamradius, Caps=panel_5, FitRail=False)

beams = Brep(pipe)

# ----
# STEP 7
# Build the roof
addition_7 = Addition(A=eavedistance, B=mudbrickwidth_2)
Z_14 = UnitZ(Factor="20")

py3_7 = Python3Script(C=clscrv_5.Closed, D=addition_7, P=rot3d.Geometry)  # -> out, S; inputs C: Polyline, D: Double, P: Plane
# ---------- py3_7: Python ----------
import Rhino.Geometry as rg

# Convert single Polyline input to NurbsCurve
if isinstance(C, rg.Polyline):
    curve = rg.PolylineCurve(C).ToNurbsCurve()
elif isinstance(C, rg.PolylineCurve):
    curve = C.ToNurbsCurve()
elif isinstance(C, rg.Curve):
    curve = C.ToNurbsCurve()
else:
    S = None
    raise ValueError("C must be a Polyline or Curve")

if curve is None:
    S = None
else:
    # Ensure closed
    if not curve.IsClosed:
        curve.MakeClosed(0.001)

    # Offset outward
    offset_curves = rg.Curve.Offset(
        curve, P, D, 0.001, rg.CurveOffsetCornerStyle.Sharp
    )

    if not offset_curves:
        offset_curves = rg.Curve.Offset(
            curve, P, -D, 0.001, rg.CurveOffsetCornerStyle.Sharp
        )

    if not offset_curves:
        S = None
    else:
        offset_curve = offset_curves[0]

        if not offset_curve.IsClosed:
            offset_curve.MakeClosed(0.001)

        surfaces = rg.Brep.CreatePlanarBreps(offset_curve, 0.001)
        S = surfaces[0] if surfaces else None
# ---------- end py3_7 ----------

move_18 = Move(Geometry=py3_7.S, Motion=Z_13)  # -> Geometry, Transform
edges_2 = BrepEdges(Brep=move_18.Geometry)  # -> Naked, Interior, NonManifold
simplify_4 = SimplifyCurve(Curve=edges_2.Naked)  # -> Curve, Simplified
explode_3 = Explode(Curve=simplify_4.Curve, Recursive=True)  # -> Segments, Vertices
py3_8 = Python3Script(Curves=explode_3.Segments, Depth=".2", MinWidth=".8", Height=".8", FilletRadius=".05")  # -> out, Breps; inputs Curves: Curve, Depth: Double, MinWidth: Double, Height: Double, FilletRadius: Double
# ---------- py3_8: Python ----------
# GH Python Script: Trapezoid Extrusion along Curves (Correct Top Fillets)
# Inputs:
#   Curves, Depth, MinWidth, Height, FilletRadius
# Output:
#   Breps

import Rhino
import Rhino.Geometry as rg
import scriptcontext as sc
import math

def flatten_curves(input_curves):
    curves = []
    if hasattr(input_curves, 'Branches'):
        for branch in input_curves.Branches:
            curves.extend(branch)
    elif hasattr(input_curves, '__iter__') and not isinstance(input_curves, rg.Curve):
        curves.extend(input_curves)
    elif isinstance(input_curves, rg.Curve):
        curves = [input_curves]
    return curves


def fillet_corner(prev_pt, corner_pt, next_pt, radius):
    """
    Computes a true fillet arc at corner_pt between edges prev->corner and corner->next.
    Returns (tan_pt_prev, tan_pt_next, arc_NurbsCurve) or None if it fails.
    The arc is built from its centre, guaranteeing tangency with both edges.
    """
    v1 = prev_pt - corner_pt
    v2 = next_pt - corner_pt
    d1 = v1.Length
    d2 = v2.Length
    if d1 < 1e-10 or d2 < 1e-10:
        return None

    v1.Unitize()
    v2.Unitize()

    dot = max(-1.0, min(1.0, v1 * v2))
    angle_between = math.acos(dot)          # full angle between edges
    half_angle = angle_between / 2.0
    if half_angle < 1e-6 or half_angle > math.pi - 1e-6:
        return None

    tan_len = radius / math.tan(half_angle)

    # Clamp radius so tangent points stay within edges
    max_tan = min(d1, d2) * 0.499
    if tan_len > max_tan:
        tan_len = max_tan
        radius = tan_len * math.tan(half_angle)

    # Tangent points on each edge
    tp1 = corner_pt + v1 * tan_len     # on edge coming from prev
    tp2 = corner_pt + v2 * tan_len     # on edge going to next

    # Arc centre: move from corner along bisector by radius/sin(half_angle)
    bisector = v1 + v2
    if bisector.Length < 1e-10:
        return None
    bisector.Unitize()
    centre = corner_pt + bisector * (radius / math.sin(half_angle))

    # Build arc using centre + two tangent points
    # Determine the plane of the arc (normal = cross of v1 and v2)
    normal = rg.Vector3d.CrossProduct(v1, v2)
    if normal.Length < 1e-10:
        return None
    normal.Unitize()

    plane = rg.Plane(centre, normal)
    arc = rg.Arc(plane, centre.DistanceTo(tp1), 0)  # placeholder - use 3pt instead

    # Use 3-point arc (start, mid, end) — mid derived from centre geometry
    # Midpoint on arc: go from centre toward corner (inward bisector reversed)
    arc_mid = centre - bisector * radius
    arc3 = rg.Arc(tp1, arc_mid, tp2)

    if not arc3.IsValid:
        return None

    return tp1, tp2, arc3.ToNurbsCurve()


def build_profile_curve(corners, fillet_flags, radius):
    """
    corners: [p0, p1, p2, p3] in order
    fillet_flags: [bool, bool, bool, bool] — which corners to fillet
    Returns a single closed NurbsCurve or None.
    """
    n = len(corners)

    # Pre-compute fillet data for each corner
    fillet_data = []
    for i in range(n):
        prev_i = (i - 1) % n
        next_i = (i + 1) % n
        if fillet_flags[i] and radius > 1e-10:
            fd = fillet_corner(corners[prev_i], corners[i], corners[next_i], radius)
            fillet_data.append(fd)  # (tp_from_prev, tp_to_next, arc) or None
        else:
            fillet_data.append(None)

    # Build ordered list of curve segments walking around the polygon
    segments = []
    for i in range(n):
        next_i = (i + 1) % n

        # Leave point from corner i
        if fillet_data[i] is not None:
            leave_pt = fillet_data[i][1]    # tp2 — tangent toward next corner
        else:
            leave_pt = corners[i]

        # Arrive point at corner next_i
        if fillet_data[next_i] is not None:
            arrive_pt = fillet_data[next_i][0]  # tp1 — tangent arriving from prev
        else:
            arrive_pt = corners[next_i]

        # Straight line segment between leave and arrive
        if leave_pt.DistanceTo(arrive_pt) > 1e-10:
            segments.append(rg.LineCurve(leave_pt, arrive_pt))

        # Arc at corner next_i (if filleted)
        if fillet_data[next_i] is not None:
            segments.append(fillet_data[next_i][2])

    if not segments:
        return None

    # Convert all to NurbsCurve and merge into one
    nurbs_segs = []
    for seg in segments:
        nc = seg.ToNurbsCurve()
        if nc:
            nurbs_segs.append(nc)

    if not nurbs_segs:
        return None

    # Join into a single closed NurbsCurve
    joined = rg.Curve.JoinCurves(nurbs_segs, sc.doc.ModelAbsoluteTolerance)
    if not joined:
        return None

    return joined[0]


def create_trapezoid_extrusions(ptA, ptB, height, angle_deg, half_depth,
                                 start_cap=False, end_cap=False, fillet_radius=0.0):
    seg_len = ptA.DistanceTo(ptB)
    inset = height / math.tan(math.radians(angle_deg))
    inset = min(inset, seg_len / 2.0)

    dir_vec = ptB - ptA
    dir_vec.Unitize()
    perp = rg.Vector3d.CrossProduct(dir_vec, rg.Vector3d(0, 0, 1))
    perp.Unitize()

    # Four corners: p0 (bottom-left), p1 (bottom-right), p2 (top-right), p3 (top-left)
    p0 = rg.Point3d(ptA)
    p1 = rg.Point3d(ptB)

    p2 = rg.Point3d(ptB)
    if not end_cap:
        p2 -= dir_vec * inset
    p2.Z += height

    p3 = rg.Point3d(ptA)
    if not start_cap:
        p3 += dir_vec * inset
    p3.Z += height

    # Fillet flags per corner:
    # p0 (bottom-left) : never
    # p1 (bottom-right): never
    # p2 (top-right)   : only when it's an 80deg inset (not an end cap vertical)
    # p3 (top-left)    : only when it's an 80deg inset (not a start cap vertical)
    fillet_flags = [False, False, not end_cap, not start_cap]

    profile = build_profile_curve([p0, p1, p2, p3], fillet_flags, fillet_radius)
    if not profile:
        return []

    brep_list = rg.Brep.CreatePlanarBreps(profile, sc.doc.ModelAbsoluteTolerance)
    if not brep_list:
        return []

    brep = brep_list[0]
    vec = perp * -half_depth * 2
    line_crv = rg.Line(p0, p0 + vec).ToNurbsCurve()
    extr = brep.Faces[0].CreateExtrusion(line_crv, True)

    return [extr] if extr else []


# MAIN
result = []
for crv in flatten_curves(Curves):
    if not isinstance(crv, rg.Curve):
        continue
    length = crv.GetLength()
    seg_count = max(1, int(math.floor(length / MinWidth)))
    params = crv.DivideByCount(seg_count, True)
    if not params or len(params) < 2:
        continue

    half_depth = Depth
    n = len(params) - 1
    for i in range(n):
        t0, t1 = params[i], params[i + 1]
        pA = crv.PointAt(t0)
        pB = crv.PointAt(t1)
        result.extend(
            create_trapezoid_extrusions(pA, pB, Height, 80, half_depth,
                                        i == 0, i == n - 1, FilletRadius)
        )

Breps = result
# ---------- end py3_8 ----------

extr_20 = Extrude(Base=py3_7.S, Direction=Z_14)

trim_3 = TrimSolid(Shape=brep_5, Cutters=extr_20)
trim_4 = TrimSolid(Shape=flatten(brep_4), Cutters=flatten(extr_20))

# ----
# texturing version
extr_21 = Extrude(Base=py3_7.S, Direction=Z_14)  # disabled

# ----
# STEP 8
extr_22 = Extrude(Base=py3_7.S, Direction=amp_7)

# ----
# STEP 1
# setout area for rock locations
offset_7 = OffsetCurve(Curve=clscrv_5.Closed, Distance=expr("x*-1", addition_7), Plane=rot3d.Geometry, Corners=1)
boundary_5 = BoundarySurfaces(Edges=offset_7)
move_19 = Move(Geometry=boundary_5, Motion=amp_7)  # -> Geometry, Transform

# ----
# STEP 2
lng_5 = ListLength(List=flatten(move_19.Geometry))
random_7 = Random(Range=Domain(1, 100), Number=lng_5, Seed=2, Integers=True)
num_7 = Number(perecentageofroofswithrocks)
py3_9 = Python3Script(x=random_7, y=num_7)  # -> out, a; inputs y: Double
# ---------- py3_9: Python ----------
if y<x:
    a=False
else:
    a=True
# ---------- end py3_9 ----------
dispatch_7 = Dispatch(List=flatten(move_19.Geometry), DispatchPattern=py3_9.a)  # -> ListA, ListB

# ----
# STEP 3
# Randomise seeds
lng_6 = ListLength(List=flatten(dispatch_7.ListA))
random_8 = Random(Range=Domain(4, 6), Number=lng_6, Seed=2, Integers=True)
random_9 = Random(Range=Domain(1, 100), Number=lng_6, Seed=2, Integers=True)

# ----
# STEP 4
# Randomise rock selection
rockcollection = Mesh(rockmeshcollection)
# Roof Rocks
lng_7 = ListLength(List=flatten(rockcollection))
dom_4 = ConstructDomain(DomainStart=0, DomainEnd=expr("x-1", lng_7))
random_10 = Random(Range=dom_4, Number=random_8, Seed=random_9, Integers=True)
item_10 = ListItem(List=rockcollection, Index=random_10, Wrap=True)

# ----
# STEP 5
# Randomise rock location rotation and scale
shift = ShiftList(List=random_9, Shift=2, Wrap=True)
shift_2 = ShiftList(List=random_9, Shift=1, Wrap=True)
random_11 = Random(Range=Domain(1, 2), Number=random_8, Seed=random_9)
random_12 = Random(Range=Domain(1, 2), Number=random_8, Seed=shift)
random_13 = Random(Range=Domain(1, 2), Number=random_8, Seed=shift_2)
scale_nu = ScaleNU(Geometry=item_10, Plane=PlaneXY(0, 0, 0), ScaleX=random_11, ScaleY=random_13, ScaleZ=random_12)  # -> Geometry, Transform
random_14 = Random(Range=Domain(0, 3.141592654), Number=random_8, Seed=random_9)
rotate = Rotate(Geometry=scale_nu.Geometry, Angle=random_14, Plane=PlaneXY(0, 0, 0))  # -> Geometry, Transform

# ----
# STEP 6
# randomise rock
# locations
pop2d = Populate2D(Region=graft(dispatch_7.ListA), Count=graft(random_8), Seed=graft(random_9))

# ----
# move rock to
# new locations
basepointofrocks = ConstructPoint(XCoordinate=0, YCoordinate=0, ZCoordinate=0)
# STEP 7
vec2pt_2 = Vector2Pt(PointA=basepointofrocks, PointB=pop2d, Unitize=False)  # -> Vector, Length
move_20 = Move(Geometry=rotate.Geometry, Motion=vec2pt_2.Vector)  # -> Geometry, Transform

crenelations = Brep(py3_8.Breps)
roofrocks = Mesh(move_20.Geometry)
roof = Brep(extr_22)

# ----
# Boolean for subtracting solid roof
trim_5 = TrimSolid(Shape=watertight_2, Cutters=extr_20)
cap = CapHoles(Brep=trim_5)

# ----
# Boolean removal of windows and doors
windows = Brep(clean_6)
doors_2 = Brep(clean)

# ----
# STEP 1
# Checks for Door Window Collisions
# and removes and clashing windows
py3_10 = Python3Script(brepsA=flatten(doors_2), brepsB=flatten(windows), frameBREPS=flatten(clean_7), doorOffset=number_slider)  # -> out, filteredB, filteredA, filteredFrames, debugLog; inputs brepsA: list of Brep, brepsB: list of Brep, frameBREPS: list of Brep, doorOffset: Double
# ---------- py3_10: Python ----------
import Rhino.Geometry as rg

tolerance = 0.01
doorOffset = doorOffset or 0.0
brepsA_list = list(brepsA)
brepsB_list = list(brepsB)
frames_list = list(frameBREPS)

def expanded_box_overlaps(bboxA, bboxB, offset):
    return not (
        bboxA.Max.X + offset < bboxB.Min.X or bboxA.Min.X - offset > bboxB.Max.X or
        bboxA.Max.Y + offset < bboxB.Min.Y or bboxA.Min.Y - offset > bboxB.Max.Y or
        bboxA.Max.Z + offset < bboxB.Min.Z or bboxA.Min.Z - offset > bboxB.Max.Z
    )

filteredB = []
filteredFrames = []

for i, brepB in enumerate(brepsB_list):
    bboxB = brepB.GetBoundingBox(True)
    collided = False

    for brepA in brepsA_list:
        bboxA = brepA.GetBoundingBox(True)

        if not expanded_box_overlaps(bboxA, bboxB, doorOffset):
            continue

        # Check actual geometry intersection
        success, curves, points = rg.Intersect.Intersection.BrepBrep(brepA, brepB, tolerance)
        if success and curves and len(curves) > 0:
            collided = True
            break

        # Fallback: containment checks (one solid inside the other, no surface intersection)
        if brepA.IsPointInside(bboxB.Center, tolerance, False):
            collided = True
            break

        if brepB.IsPointInside(bboxA.Center, tolerance, False):
            collided = True
            break

    if not collided:
        filteredB.append(brepB)
        if i < len(frames_list):
            filteredFrames.append(frames_list[i])

a = filteredB
b = filteredFrames
# ---------- end py3_10 ----------

trim_6 = TrimSolid(Shape=cap, Cutters=py3_10.filteredB)

windowframes = Brep(py3_10.filteredFrames)

# ----
# STEP 2
# Trims window booleans from the walls
trim_7 = TrimSolid(Shape=trim_6, Cutters=py3_10.filteredB)  # disabled
trim_8 = TrimSolid(Shape=flatten(trim_3), Cutters=flatten(py3_10.filteredB))
trim_9 = TrimSolid(Shape=flatten(trim_4), Cutters=flatten(py3_10.filteredB))
wallext = Brep(trim_8)
watertightmud = Brep(trim_7)  # disabled
wallint = Brep(trim_9)

# ----
# STEP 3
# These need to go through the window algortithm
foundationext = Brep(stonewallext)
foundationint = Brep(stonewallint)
srf_2 = Surface(stonewalltop)
brep_6 = Brep(brep_3)
trim_10 = TrimSolid(Shape=watertightmud, Cutters=brep_3)  # disabled
trim_11 = TrimSolid(Shape=graft(srf_2), Cutters=brep_6)
trim_12 = TrimSolid(Shape=watertight, Cutters=brep_3)  # disabled

# ----
# Trims door booleans from the walls
trim_13 = TrimSolid(Shape=foundationext, Cutters=brep_3)
trim_14 = TrimSolid(Shape=wallint, Cutters=brep_3)
trim_15 = TrimSolid(Shape=foundationint, Cutters=brep_3)
trim_16 = TrimSolid(Shape=wallext, Cutters=brep_3)

join_11 = BrepJoin(Breps=flatten([clean_7, trim_10, extr_9]))  # -> Breps, Closed; disabled
watertightmudwall = Brep(join_11.Breps)  # disabled
substructuretop = Brep(trim_11)
windowframes_2 = Brep(windowframes)
foundationext_2 = Brep(trim_13)
foundationint_2 = Brep(trim_15)
wallint_2 = Brep(trim_14)
wallext_2 = Brep(trim_16)
