# Grasshopper definition ThesisCSV_ReadAndWritePublish.gh (Grasshopper 1.0.8)

# ----
# INPUTS CSV IN
panel = Panel("/Users/???/Library/Desktop/attributes.csv")
ycorrect = Panel("-4275000")
xcorrect = Panel("-580000")

# ----
# INPUTS CSV OUT
panel_2 = Panel("/Users/timothysullivan/Desktop")
curvestoexport = Curve([<curve referenced from the Rhino model> x1872])  # disabled

path = FilePath("/Users/???/Library/Desktop/nodes.csv")
# ENABLE/DISABLE
path_2 = FilePath(panel)

# ----
# SCRIPTA
scripta_recalibrate_and_sort = Python3Script(csvFile=path, xCorrect=xcorrect, yCorrect=ycorrect)  # -> out, Pts, IDList, IsClosed, Polylines; inputs csvFile: String, xCorrect: Double, yCorrect: Double
# ---------- scripta_recalibrate_and_sort: Python ----------
import csv
import os
from collections import defaultdict
from Grasshopper import DataTree
from Grasshopper.Kernel.Data import GH_Path
import Rhino.Geometry as rg

shapes = defaultdict(list)

if isinstance(csvFile, str) and os.path.exists(csvFile):
    rows = list(csv.reader(open(csvFile, 'r')))
else:
    rows = list(csv.reader(csvFile.splitlines()))

if rows:
    rows = rows[1:]

for row in rows:
    if len(row) < 5:
        continue
    try:
        sid = int(row[1])
        x = float(row[3]) + xCorrect
        y = float(row[4]) + yCorrect
    except:
        continue
    shapes[sid].append(rg.Point3d(x, y, 0.0))

TOLERANCE = 0.01

Pts = DataTree[rg.Point3d]()
Polylines = DataTree[rg.Polyline]()
IDList = []
IsClosed = []

i = 0
for sid in sorted(shapes.keys()):
    path = GH_Path(i)
    pts = shapes[sid]

    # Check if first and last vertices are coincidental
    is_closed = False
    if len(pts) >= 2:
        first = pts[0]
        last = pts[-1]
        dist = first.DistanceTo(last)
        if dist < TOLERANCE:
            pts = pts[:-1]  # Remove coincidental last vertex
            is_closed = True

    # Add points to tree
    for pt in pts:
        Pts.Add(pt, path)

    # Create polyline
    pl = rg.Polyline(pts)
    if is_closed:
        pl.Add(pl[0])  # Close it properly by adding first point again for Rhino rendering

    Polylines.Add(pl, path)
    IDList.append(sid)
    IsClosed.append(is_closed)

    i += 1
# ---------- end scripta_recalibrate_and_sort ----------

# ----
# SCRIPTB
b_attributeextraction = Python3Script(csvFile=path_2, IDList=scripta_recalibrate_and_sort.IDList)  # -> out, source, certainty, BType, width_estimated, height_estimated, a; inputs csvFile: String, IDList: list
# ---------- b_attributeextraction: Python ----------
import csv
import os

# ----------------------------
# Read CSV
# ----------------------------
if isinstance(csvFile, str) and os.path.exists(csvFile):
    f = open(csvFile, 'r')
    rows = list(csv.reader(f))
    f.close()
else:
    rows = list(csv.reader(csvFile.splitlines()))

# Remove header row
if len(rows) > 1:
    rows = rows[1:]
else:
    rows = []

# ----------------------------
# Build lookup by shapeID (Column A)
# ----------------------------
lookup = {}
for row in rows:
    try:
        sid = int(str(row[0]).replace('"', '').strip())
        lookup[sid] = row
    except:
        pass

# ----------------------------
# Initialise outputs ONCE
# ----------------------------
source = []
certainty = []
BType = []
width_estimated = []
height_estimated = []

# ----------------------------
# Main loop (aligned to IDList)
# ----------------------------
for sid in IDList:

    try:
        sid = int(sid)
    except:
        source.append(None)
        certainty.append(None)
        BType.append(None)
        width_min.append(None)
        width_max.append(None)
        continue

    if sid not in lookup:
        source.append(None)
        certainty.append(None)
        BType.append(None)
        width_estimated.append(None)
        height_estimated.append(None)
        continue

    row = lookup[sid]

    # Column D
    try:
        source.append(row[4] if row[4] != "" else None)
    except:
        source.append(None)

    # Column E (certainty)
    try:
        certainty.append(row[4] if row[4] != "" else None)
    except:
        certainty.append(None)

    # Column G (BType)
    try:
        BType.append(row[6] if row[6] != "" else None)
    except:
        BType.append(None)

    # Column J (width_estimated)
    try:
        vmin = row[9]
        width_estimated.append(float(vmin) if str(vmin).strip() != "" else None)
    except:
        width_estimated.append(None)

    # Column K (height_estimated)
    try:
        vmax = row[10]
        height_estimated.append(float(vmax) if str(vmax).strip() != "" else None)
    except:
        height_estimated.append(None)
# ---------- end b_attributeextraction ----------

num = Number(ycorrect)
num_2 = Number(xcorrect)

# ----
# SCRIPTC
c_polyline_attribute_trees = Python3Script(
    PolyLines=scripta_recalibrate_and_sort.Pts,
    IDList=scripta_recalibrate_and_sort.IDList,
    certainty=b_attributeextraction.certainty,
    BType=b_attributeextraction.BType,
    width_estimated=b_attributeextraction.width_estimated,
    height_estimated=b_attributeextraction.height_estimated)  # -> out, debug, PolyLineTree, IDTree, certaintyTree, BTypeTree, width_estimatedTree, height_estimatedTree; inputs PolyLines: tree of Point3d, IDList: list of Int32, certainty: list of String, BType: list of String, width_estimated: list, height_estimated: list
# ---------- c_polyline_attribute_trees: Python ----------
import Rhino.Geometry as rg
from Grasshopper import DataTree
from Grasshopper.Kernel.Data import GH_Path

# -------------------------
# Allowed values
# -------------------------
VALID_CERTAINTY = {
    "exc_sur_gen",
    "surface",
    "probable",
    "possible",
    "speculative"
}
VALID_BTYPE = {
    "street",
    "Building",
    "Partition",
    "CircuitInterior",
    "CircuitExterior",
    "Tower-Bastion",
    "Retaining",
    "Buttress",
    "Fence",
    "Pen",
    "Road",
    "silo"
}

FILTER_BTYPES = {"Building", "Tower-Bastion"}
TOLERANCE = 0.01

# -------------------------
# Prepare outputs (typed)
# -------------------------
certaintyTree = DataTree[str]()
IDTree = DataTree[int]()
BTypeTree = DataTree[str]()
width_estimatedTree = DataTree[object]()
height_estimatedTree = DataTree[object]()
TooSmallVertexListErrors = []
SelfIntersectListErrors = []
debug = ""
valid = True

# -------------------------
# Normalise lists
# -------------------------
IDList = list(IDList)
certainty = list(certainty)
BType = list(BType)
width_estimated = list(width_estimated)
height_estimated = list(height_estimated)

# -------------------------
# Check list lengths
# -------------------------
if not (len(IDList) == len(certainty) == len(BType) == len(width_estimated) == len(height_estimated)):
    debug = "lists are not the same length"
    valid = False

# -------------------------
# Validate certainty values (verbose)
# -------------------------
if valid:
    for i, c in enumerate(certainty):
        if c not in VALID_CERTAINTY:
            debug = (
                "unrecognised item in certainty list: '{}' "
                "at index {}. please correct or add it to the source code"
            ).format(c, i)
            valid = False
            break

# -------------------------
# Validate BType values (verbose)
# -------------------------
if valid:
    for i, b in enumerate(BType):
        if b not in VALID_BTYPE:
            debug = (
                "unrecognised item in Btype list: '{}' "
                "at index {}. please correct or add it to the source code"
            ).format(b, i)
            valid = False
            break

# -------------------------
# Validate PolyLines structure
# -------------------------
if valid:
    if PolyLines.BranchCount == 0:
        debug = "the PolyLine datatree doesn't match the list lengths"
        valid = False

if valid:
    if PolyLines.BranchCount != len(IDList):
        debug = "the PolyLine datatree doesn't match the list lengths"
        valid = False

# -------------------------
# Match lists to PolyLines tree, applying filters only to FILTER_BTYPES
# -------------------------
PolyLineTree = DataTree[rg.Polyline]()

if valid:
    out_i = 0
    for i in range(PolyLines.BranchCount):
        sid = IDList[i]
        btype = BType[i]
        pts = list(PolyLines.Branches[i])

        # Build polyline from points
        if len(pts) < 2:
            continue
        pl = rg.Polyline(pts)

        # --- Apply filters only to Building and Tower-Bastion ---
        if btype in FILTER_BTYPES:

            # Filter 1: Too few vertices
            if len(pts) <= 3:
                TooSmallVertexListErrors.append(sid)
                continue

            # Filter 2: Self-intersection
            pl_curve = pl.ToNurbsCurve()
            if pl_curve is not None:
                intersections = rg.Intersect.Intersection.CurveSelf(pl_curve, TOLERANCE)
                if intersections is not None and intersections.Count > 0:
                    SelfIntersectListErrors.append(sid)
                    continue

        # --- Passed filters (or not a filtered BType): add to outputs ---
        out_path = GH_Path(out_i)
        certaintyTree.Add(certainty[i], out_path)
        IDTree.Add(sid, out_path)
        BTypeTree.Add(btype, out_path)
        width_estimatedTree.Add(width_estimated[i], out_path)
        height_estimatedTree.Add(height_estimated[i], out_path)
        PolyLineTree.Add(pl, out_path)
        out_i += 1
# ---------- end c_polyline_attribute_trees ----------

# ----
# FIND LAYERS NAMES
# FROM OBJECTS
object = ModelObject(Object=curvestoexport)  # -> Object, Geometry, Name, Layer, Visibility, Display, Drafting, Render

# ----
# SCRIPTD
d_layer_names_from_attributres = Python3Script(
    PolyLineTree=c_polyline_attribute_trees.PolyLineTree,
    IDTree=c_polyline_attribute_trees.IDTree,
    certaintyTree=c_polyline_attribute_trees.certaintyTree,
    BTypeTree=c_polyline_attribute_trees.BTypeTree)  # -> out, OutputTree, OutputIDTree, LabelTree; inputs PolyLineTree: tree of Polyline, IDTree: tree of Int32, certaintyTree: tree of String, BTypeTree: tree of String
# ---------- d_layer_names_from_attributres: Python ----------
from Grasshopper import DataTree
from Grasshopper.Kernel.Data import GH_Path
import Rhino.Geometry as rg

# -------------------------
# Prepare outputs (typed)
# -------------------------
OutputTree = DataTree[rg.Polyline]()
OutputIDTree = DataTree[int]()
LabelTree = DataTree[str]()

# -------------------------
# Accumulator:
# key = "BType_certainty"
# value = list of (polyline, id)
# -------------------------
groups = {}

# -------------------------
# Traverse input trees
# -------------------------
for i in range(PolyLineTree.BranchCount):
    pl_branch = PolyLineTree.Branches[i]
    bt_branch = BTypeTree.Branches[i]
    cert_branch = certaintyTree.Branches[i]
    id_branch = IDTree.Branches[i]

    # One item per branch (by design)
    polyline = pl_branch[0]
    btype = bt_branch[0]
    certainty = cert_branch[0]
    id_val = id_branch[0]

    key = "{}_{}".format(btype, certainty)

    if key not in groups:
        groups[key] = []

    groups[key].append((polyline, id_val))

# -------------------------
# Build output trees
# -------------------------
for path_index, key in enumerate(sorted(groups.keys())):
    path = GH_Path(path_index)

    for polyline, id_val in groups[key]:
        OutputTree.Add(polyline, path)
        OutputIDTree.Add(id_val, path)
        LabelTree.Add(key, path)
# ---------- end d_layer_names_from_attributres ----------

# ----
# EXPORT NODES AND ATTRIBUTES
# AS CSV FILE
toggle = BooleanToggle(False)
withheight = Python3Script(Crvs=curvestoexport, Xcorrect=num, Ycorrect=num_2, Folder=panel_2, LayerNames=object.Layer, Run=toggle)  # -> out, NodesPath, ShapesPath, LayerDebug, ObjectDebug, TypeDebug; inputs Crvs: list of Curve, Xcorrect: Double, Ycorrect: Double, Folder: String, LayerNames: list of String, Run: Boolean
# ---------- withheight: Python ----------
import Rhino
import csv
import os

NodesPath = None
ShapesPath = None

# -------------------------------------------------
# Guard: only run when toggled
# -------------------------------------------------
if Run:

    nodes_rows  = []
    shapes_rows = []

    shape_id = 0
    fid = 1

    Xc = float(Xcorrect)
    Yc = float(Ycorrect)

    for i, crv in enumerate(Crvs):

        if not crv:
            continue

        # -------------------------------
        # Extract polyline
        # -------------------------------
        pl = None

        if isinstance(crv, Rhino.Geometry.Polyline):
            pl = crv

        elif isinstance(crv, Rhino.Geometry.PolylineCurve):
            pl = crv.ToPolyline()

        elif isinstance(crv, Rhino.Geometry.Curve):
            tmp = Rhino.Geometry.Polyline()
            if crv.TryGetPolyline(tmp):
                pl = tmp

        if not pl:
            continue

        if pl.IsClosed:
            pl = Rhino.Geometry.Polyline(pl)
            pl.RemoveAt(pl.Count - 1)

        # -------------------------------
        # Layer parsing (clean + height)
        # -------------------------------
        raw_layer = ""
        if LayerNames and i < len(LayerNames):
            raw_layer = LayerNames[i]

        layer_name = raw_layer

        # Remove GH prefix
        if "Model Layer" in layer_name:
            layer_name = layer_name.split(":", 1)[1]

        # Remove GUID suffix
        if " : {" in layer_name:
            layer_name = layer_name.split(" : {", 1)[0]

        layer_name = layer_name.strip()

        parts = layer_name.split("_")

        BType = parts[0] if len(parts) > 0 else ""
        certainty = parts[1] if len(parts) > 1 else ""
        height = parts[2] if len(parts) > 2 else ""

        # -------------------------------
        # Node CSV
        # -------------------------------
        for pt in pl:
            x = pt.X + (-1.0 * Xc)
            y = pt.Y + (-1.0 * Yc)

            nodes_rows.append([
                str(shape_id),
                "0",
                x,
                y
            ])

        # -------------------------------
        # Shape CSV
        # -------------------------------
        shapes_rows.append([
            str(shape_id),
            fid,
            BType,
            certainty,
            height
        ])

        shape_id += 1
        fid += 1

    # -------------------------------------------------
    # Write CSV files
    # -------------------------------------------------
    nodes_path  = os.path.join(Folder, "nodesCSVOutput.csv")
    shapes_path = os.path.join(Folder, "shapesCSVOutput.csv")

    with open(nodes_path, "w") as f:
        writer = csv.writer(f)
        writer.writerow(["shapeid", "partid", "x", "y"])
        writer.writerows(nodes_rows)

    with open(shapes_path, "w") as f:
        writer = csv.writer(f)
        writer.writerow(["shapeid", "fid", "certainty",  "BType"])
        writer.writerows(shapes_rows)

    NodesPath  = nodes_path
    ShapesPath = shapes_path
# ---------- end withheight ----------
panel_3 = Panel([withheight.ObjectDebug, withheight.TypeDebug, withheight.LayerDebug, withheight.ShapesPath, withheight.NodesPath])

# ----
# SCRIPTE
toggle_2 = BooleanToggle(False)
sublayers_e_createlayers_from_attributed = Python3Script(LabelTree=d_layer_names_from_attributres.LabelTree, Run=toggle_2)  # -> out, CreatedLayers, ExistingLayers; "SUBLAYERS_E-createLayers from attributedata"; inputs LabelTree: tree of String, Run: Boolean
# ---------- sublayers_e_createlayers_from_attributed: Python ----------
import Rhino
import random
from System.Drawing import Color

CreatedLayers = []
ExistingLayers = []

def get_or_create_parent_layer(layer_table, name):
    """Get existing parent layer index or create it, returns index."""
    index = layer_table.FindByFullPath(name, -1)
    if index == -1:
        layer = Rhino.DocObjects.Layer()
        layer.Name = name
        layer.Color = Color.FromArgb(128, 128, 128)  # neutral grey for parents
        index = layer_table.Add(layer)
    return index

def create_sublayer(layer_table, name, parent_index, color):
    """Create a sublayer under a given parent index."""
    layer = Rhino.DocObjects.Layer()
    layer.Name = name
    layer.Color = color
    layer.ParentLayerId = layer_table[parent_index].Id
    return layer_table.Add(layer)

if Run:
    doc = Rhino.RhinoDoc.ActiveDoc
    layer_table = doc.Layers

    # -------------------------
    # Collect unique labels
    # -------------------------
    labels = set()
    for branch in LabelTree.Branches:
        for item in branch:
            if item:
                labels.add(str(item))

    # -------------------------
    # Get or create master parent layers
    # -------------------------
    parent_2d_index = get_or_create_parent_layer(layer_table, "2D")
    parent_3d_index = get_or_create_parent_layer(layer_table, "3D")

    # -------------------------
    # Create sublayers under 2D and 3D
    # -------------------------
    for name in sorted(labels):

        # --- Random but readable colour (shared between pair) ---
        r = random.randint(40, 230)
        g = random.randint(40, 230)
        b = random.randint(40, 230)
        color = Color.FromArgb(r, g, b)

        # --- 2D sublayer ---
        full_path_2d = "2D::" + name
        index_2d = layer_table.FindByFullPath(full_path_2d, -1)
        if index_2d == -1:
            create_sublayer(layer_table, name, parent_2d_index, color)
            CreatedLayers.append(full_path_2d)
        else:
            ExistingLayers.append(full_path_2d)

        # --- 3D sublayer (prefixed name) ---
        name_3d = "3D_" + name
        full_path_3d = "3D::" + name_3d
        index_3d = layer_table.FindByFullPath(full_path_3d, -1)
        if index_3d == -1:
            create_sublayer(layer_table, name_3d, parent_3d_index, color)
            CreatedLayers.append(full_path_3d)
        else:
            ExistingLayers.append(full_path_3d)

    # Optional redraw
    if doc.Views:
        doc.Views.Redraw()
# ---------- end sublayers_e_createlayers_from_attributed ----------

# ----
# SCRIPTF
toggle_3 = BooleanToggle(False)
f_creategeometry = Python3Script(OutputTree=d_layer_names_from_attributres.OutputTree, LabelTree=d_layer_names_from_attributres.LabelTree, Run=toggle_3)  # -> out, BakedIDs, MissingLayers, Debug; inputs OutputTree: tree of Polyline, LabelTree: tree of String
# ---------- f_creategeometry: Python ----------
import Rhino
import Rhino.Geometry as rg

BakedIDs = []
MissingLayers = []

if Run:
    doc = Rhino.RhinoDoc.ActiveDoc
    layers = doc.Layers

    branch_count = min(
        OutputTree.BranchCount,
        LabelTree.BranchCount
    )

    for i in range(branch_count):
        poly_branch = OutputTree.Branches[i]
        label_branch = LabelTree.Branches[i]

        if not label_branch:
            continue

        # Build full path with 2D parent layer
        layer_name = str(label_branch[0])
        full_path = "2D::{}".format(layer_name)

        layer_index = layers.FindByFullPath(full_path, -1)

        if layer_index == -1:
            if full_path not in MissingLayers:
                MissingLayers.append(full_path)
            continue

        for polyline in poly_branch:
            if not polyline or polyline.Count < 2:
                continue

            curve = polyline.ToNurbsCurve()
            attr = Rhino.DocObjects.ObjectAttributes()
            attr.LayerIndex = layer_index
            obj_id = doc.Objects.AddCurve(curve, attr)

            if obj_id:
                BakedIDs.append(obj_id)
# ---------- end f_creategeometry ----------
panel_4 = Panel(f_creategeometry.Debug)
