# Grasshopper definition ThesisFencePublish.gh (Grasshopper 1.0.8)
# plug-ins: LunchBox

# ----
# Buttress
substructurewidth = Panel(".687")
substructureheight = Panel("1")
mudbrickwidth = Panel("0")
buttress_possible = Curve([<curve referenced from the Rhino model> x16])
butress_probable = Curve([<curve referenced from the Rhino model> x12])
buttress_exist = Curve([<curve referenced from the Rhino model> x3])

# ----
# CircuitInterior
substructurewidth_2 = Panel("1.37")
mudbrickwidth_2 = Panel("1.37")
mudbrickheight_2 = Panel("1.5")
circuitinterior_possible = Curve([<curve referenced from the Rhino model> x6])
circuitinterior_exist = Curve([<curve referenced from the Rhino model> x7])
butress_probable_2 = Curve([<curve referenced from the Rhino model> x8])

# ----
# CircuitExterior
substructurewidth_3 = Panel("1.77")
substructureheight_3 = Panel("1")
mudbrickwidth_3 = Panel("1.77")
mudbrickheight_3 = Panel("2")
circuitinterior_possible_2 = Curve([<curve referenced from the Rhino model> x9])
circuitinterior_exist_2 = Curve([<curve referenced from the Rhino model> x6])
butress_probable_3 = Curve([<curve referenced from the Rhino model> x13])

# ----
# Roads
substructurewidth_4 = Panel("3")
substructureheight_4 = Panel(".15")
road_probable = Curve([<curve referenced from the Rhino model> x58])
road_possible = Curve([<curve referenced from the Rhino model> x45])  # disabled

# ----
# RetainingWalls
substructurewidth_5 = Panel(".73")
substructureheight_5 = Panel("-1")
mudbrickwidth_5 = Panel(".73")
specualtive = Curve([<curve referenced from the Rhino model> x13])  # disabled
excavated = Curve([<curve referenced from the Rhino model> x2])  # disabled
probable = Curve([<curve referenced from the Rhino model> x34])
possible = Curve([<curve referenced from the Rhino model> x54])

# ----
# Pens
substructurewidth_6 = Panel(".735")
substructureheight_6 = Panel(".9")
pen_possible = Curve([<curve referenced from the Rhino model> x3])
pen_probable = Curve([<curve referenced from the Rhino model> x3])

# ----
# Fences
mudbrickwidth_7 = Panel(".73")
substructurewidth_7 = Panel(".735")
mudbrickheight_7 = Panel("1.3")
substructureheight_7 = Panel(".2")
specualtive_2 = Curve([<curve referenced from the Rhino model> x10])  # disabled
excavated_2 = Curve([<curve referenced from the Rhino model> x10])
probable_2 = Curve([<curve referenced from the Rhino model> x12])
possible_2 = Curve([<curve referenced from the Rhino model> x11])

# ----
# CRENEL PARAMS
creneldepth = Panel(".2")
crenelminwidth = Panel(".8")
crenelheight = Panel(".8")
filletradius = Panel(".05")

# ----
# EXT INPUTS
substructurewidth_8 = Number(substructurewidth_3)
substructureheight_8 = Number(substructureheight_3)
mudbrickwidth_8 = Number(mudbrickwidth_3)
mudbrickheight_8 = Number(mudbrickheight_3)
fencepolylines = Curve(butress_probable_3)

# ----
# PARAMETERS
wallwidth = Panel(mudbrickwidth_8)
footingwidth = Panel(substructurewidth_8)

# ----
# INT INPUTS
demmesh = Mesh(<mesh referenced from the Rhino model>)
xy = XYPlane(Origin=Point(0, 0, 0))

# ----
# STEP 1
# PARAMETER
# LOGIC
# CHECK
# Checks that the mudbrick wall is not thicker than the substructure.  If so it overrides the mudbrick thickness and forces it to be the same as the substructure
mudbrickcheck = Python3Script(WallWidth=wallwidth, FootingWidth=footingwidth)  # -> out, NewWallWidth
# ---------- mudbrickcheck: Python ----------
"Check that mudbrick is not wider than the footing if so override"
if WallWidth>FootingWidth:
    NewWallWidth=FootingWidth
else:
    NewWallWidth=WallWidth
# ---------- end mudbrickcheck ----------

clean = CleanTree(RemoveNulls=True, RemoveInvalid=True, RemoveEmpty=False, Tree=fencepolylines)

# ----
# STEP 2 - MUD BRICK SCRIPT
# 2.4
# 2.7
# 2.8
# 2.3
# 2.6
# 2.9
# offset the line in one direction
# Join the polylines to make sure there aren't any stray segments
# Find the end and start points of each line
# remove an null or failed offsets to ensure the data structure remains consistant
# End of the offset for offset lines
# join all the lines into a closed polyline
# 2.1
# 2.5
# divide the thickness of the wall into two for each side
# offset the line in the other direction
# 2.2
panel = Panel("2")
division = Division(A=mudbrickcheck.NewWallWidth, B=panel)
join = JoinCurves(Curves=clean, Preserve=False)
neg = Negative(Value=division)
offset = OffsetCurve(Curve=clean, Distance=division, Plane=xy, Corners=1)
offset_2 = OffsetCurve(Curve=fencepolylines, Distance=neg, Plane=xy, Corners=1)
clean_2 = CleanTree(RemoveNulls=True, RemoveInvalid=True, RemoveEmpty=False, Tree=offset)
clean_3 = CleanTree(RemoveNulls=True, RemoveInvalid=True, RemoveEmpty=False, Tree=offset_2)
end = EndPoints(Curve=clean_2)  # -> Start, End
end_2 = EndPoints(Curve=clean_3)  # -> Start, End
ln = Line(StartPoint=end.Start, EndPoint=end_2.Start)
ln_2 = Line(StartPoint=end.End, EndPoint=end_2.End)
walloutline = Curve(clean_2)
walloutline_2 = Curve(clean_3)
wallend = Curve(ln)
wallend_2 = Curve(ln_2)
join_2 = JoinCurves(Curves=[wallend_2, walloutline_2, wallend, walloutline], Preserve=False)

simplify = SimplifyCurve(Curve=fencepolylines)  # -> Curve, Simplified

# ----
# STEP 3 -SUB STRUCTURE SCRIPT
# 3.4
# 3.7
# 3.8
# 3.3
# 3.6
# 3.9
# offset the line in one direction
# Join the polylines to make sure there aren't any stray segments
# Find the end and start points of each line
# remove an null or failed offsets to ensure the data structure remains consistant
# End of the offset for offset lines
# join all the lines into a closed polyline
# 3.1
# 3.5
# divide the thickness of the wall into two for each side
# offset the line in the other direction
# 3.2
panel_2 = Panel("2")
division_2 = Division(A=footingwidth, B=panel_2)
neg_2 = Negative(Value=division_2)
offset_3 = OffsetCurve(Curve=simplify.Curve, Distance=division_2, Plane=xy, Corners=1)
offset_4 = OffsetCurve(Curve=simplify.Curve, Distance=neg_2, Plane=xy, Corners=1)
clean_4 = CleanTree(RemoveNulls=True, RemoveInvalid=True, RemoveEmpty=False, Tree=offset_3)
clean_5 = CleanTree(RemoveNulls=True, RemoveInvalid=True, RemoveEmpty=False, Tree=offset_4)
end_3 = EndPoints(Curve=clean_4)  # -> Start, End
end_4 = EndPoints(Curve=clean_5)  # -> Start, End
ln_3 = Line(StartPoint=end_3.Start, EndPoint=end_4.Start)
ln_4 = Line(StartPoint=end_3.End, EndPoint=end_4.End)
walloutline_3 = Curve(clean_4)
walloutline_4 = Curve(clean_5)
wallend_3 = Curve(ln_3)
wallend_4 = Curve(ln_4)
join_3 = JoinCurves(Curves=[wallend_4, walloutline_4, wallend_3, walloutline_3], Preserve=False)

# ----
# STEP 4
# OUTPUT
# This curve should get projected up to the mesh now
mudwalloutline = Curve(join_2)
footingoutline = Curve(join_3)

# ----
# STEP 5
# PROJECTIONS
# The curves are both projected to the DEM
py3 = Python3Script(curve=footingoutline, mesh=demmesh)  # -> out, projected_curves, debug; inputs curve: Curve, mesh: Mesh
# ---------- py3: Python ----------
import Rhino
import Rhino.Geometry as rg

projected_curves = []
debug = ""

try:
    tol = Rhino.RhinoDoc.ActiveDoc.ModelAbsoluteTolerance
    z_dir = rg.Vector3d(0, 0, 1)

    if curve is None:
        debug = "ERROR: No curve provided."
    elif mesh is None:
        debug = "ERROR: No mesh provided."
    else:
        result = rg.Curve.ProjectToMesh(curve, mesh, z_dir, tol)
        if result and len(result) > 0:
            projected_curves = list(result)
            debug = "OK: {} segment(s) projected.".format(len(projected_curves))
        else:
            debug = "WARNING: No result. Ensure curve is above or below the mesh."

except Exception as e:
    debug = "EXCEPTION: {}".format(str(e))
# ---------- end py3 ----------
py3_2 = Python3Script(curve=mudwalloutline, mesh=demmesh)  # -> out, projected_curves, debug; inputs curve: Curve, mesh: Mesh; same code as py3

substructureheight_9 = Panel(substructureheight_8)
mudbrickheight_9 = Panel(mudbrickheight_8)

# ----
# SUBSTRUCTURE EXTRUSIONS
# The polylines are converted to patch surfaces
# The Substructure patch is extruded
projectedsubstructurecurves = Curve(flatten(py3.projected_curves))
Z = UnitZ(Factor=substructureheight_9)
patch = PatchSurface(EdgeCurves=graft(projectedsubstructurecurves), U=2, V=2, Tolerance=0.001)
extr = Extrude(Base=patch, Direction=Z)

# ----
# MUDBRICK EXTRUSIONS
# The mudbrick patch is moved up the same distance as the substructure extrude
# The polylines are converted to patch surfaces
# The polylines are simplified
projectedmudbrickcurves = Curve(py3_2.projected_curves)
simplify_2 = SimplifyCurve(Curve=projectedmudbrickcurves)  # -> Curve, Simplified
z_vecsubstructure = Vector(Z)
Z_2 = UnitZ(Factor=mudbrickheight_9)

crv = Curve(flatten(simplify_2.Curve))
patch_2 = PatchSurface(EdgeCurves=graft(crv), U=2, V=2, Tolerance=0.001)

move = Move(Geometry=patch_2, Motion=z_vecsubstructure)  # -> Geometry, Transform
# The mudbrick patch is extruded
extr_2 = Extrude(Base=move.Geometry, Direction=Z_2)

# ----
# CRENELATIONS (Circuit Exterior Only)
move_2 = Move(Geometry=move.Geometry, Motion=Z_2)  # -> Geometry, Transform
edges = BrepEdges(Brep=move_2.Geometry)  # -> Naked, Interior, NonManifold
simplify_3 = SimplifyCurve(Curve=edges.Naked)  # -> Curve, Simplified
explode = Explode(Curve=simplify_3.Curve, Recursive=True)  # -> Segments, Vertices
py3_3 = Python3Script(Curves=explode.Segments, Depth=creneldepth, MinWidth=crenelminwidth, Height=crenelheight, FilletRadius=filletradius)  # -> out, Breps; inputs Curves: Curve, Depth: Double, MinWidth: Double, Height: Double, FilletRadius: Double
# ---------- py3_3: Python ----------
# GH Python Script: Trapezoid Extrusion along Curves (Correct Top Fillets)
# Inputs:
#   Curves, Depth, MinWidth, Height, FilletRadius
# Output:
#   Breps

import Rhino
import Rhino.Geometry as rg
import scriptcontext as sc
import math

def flatten_curves(input_curves):
    curves = []
    if hasattr(input_curves, 'Branches'):
        for branch in input_curves.Branches:
            curves.extend(branch)
    elif hasattr(input_curves, '__iter__') and not isinstance(input_curves, rg.Curve):
        curves.extend(input_curves)
    elif isinstance(input_curves, rg.Curve):
        curves = [input_curves]
    return curves


def fillet_corner(prev_pt, corner_pt, next_pt, radius):
    """
    Computes a true fillet arc at corner_pt between edges prev->corner and corner->next.
    Returns (tan_pt_prev, tan_pt_next, arc_NurbsCurve) or None if it fails.
    The arc is built from its centre, guaranteeing tangency with both edges.
    """
    v1 = prev_pt - corner_pt
    v2 = next_pt - corner_pt
    d1 = v1.Length
    d2 = v2.Length
    if d1 < 1e-10 or d2 < 1e-10:
        return None

    v1.Unitize()
    v2.Unitize()

    dot = max(-1.0, min(1.0, v1 * v2))
    angle_between = math.acos(dot)          # full angle between edges
    half_angle = angle_between / 2.0
    if half_angle < 1e-6 or half_angle > math.pi - 1e-6:
        return None

    tan_len = radius / math.tan(half_angle)

    # Clamp radius so tangent points stay within edges
    max_tan = min(d1, d2) * 0.499
    if tan_len > max_tan:
        tan_len = max_tan
        radius = tan_len * math.tan(half_angle)

    # Tangent points on each edge
    tp1 = corner_pt + v1 * tan_len     # on edge coming from prev
    tp2 = corner_pt + v2 * tan_len     # on edge going to next

    # Arc centre: move from corner along bisector by radius/sin(half_angle)
    bisector = v1 + v2
    if bisector.Length < 1e-10:
        return None
    bisector.Unitize()
    centre = corner_pt + bisector * (radius / math.sin(half_angle))

    # Build arc using centre + two tangent points
    # Determine the plane of the arc (normal = cross of v1 and v2)
    normal = rg.Vector3d.CrossProduct(v1, v2)
    if normal.Length < 1e-10:
        return None
    normal.Unitize()

    plane = rg.Plane(centre, normal)
    arc = rg.Arc(plane, centre.DistanceTo(tp1), 0)  # placeholder - use 3pt instead

    # Use 3-point arc (start, mid, end) — mid derived from centre geometry
    # Midpoint on arc: go from centre toward corner (inward bisector reversed)
    arc_mid = centre - bisector * radius
    arc3 = rg.Arc(tp1, arc_mid, tp2)

    if not arc3.IsValid:
        return None

    return tp1, tp2, arc3.ToNurbsCurve()


def build_profile_curve(corners, fillet_flags, radius):
    """
    corners: [p0, p1, p2, p3] in order
    fillet_flags: [bool, bool, bool, bool] — which corners to fillet
    Returns a single closed NurbsCurve or None.
    """
    n = len(corners)

    # Pre-compute fillet data for each corner
    fillet_data = []
    for i in range(n):
        prev_i = (i - 1) % n
        next_i = (i + 1) % n
        if fillet_flags[i] and radius > 1e-10:
            fd = fillet_corner(corners[prev_i], corners[i], corners[next_i], radius)
            fillet_data.append(fd)  # (tp_from_prev, tp_to_next, arc) or None
        else:
            fillet_data.append(None)

    # Build ordered list of curve segments walking around the polygon
    segments = []
    for i in range(n):
        next_i = (i + 1) % n

        # Leave point from corner i
        if fillet_data[i] is not None:
            leave_pt = fillet_data[i][1]    # tp2 — tangent toward next corner
        else:
            leave_pt = corners[i]

        # Arrive point at corner next_i
        if fillet_data[next_i] is not None:
            arrive_pt = fillet_data[next_i][0]  # tp1 — tangent arriving from prev
        else:
            arrive_pt = corners[next_i]

        # Straight line segment between leave and arrive
        if leave_pt.DistanceTo(arrive_pt) > 1e-10:
            segments.append(rg.LineCurve(leave_pt, arrive_pt))

        # Arc at corner next_i (if filleted)
        if fillet_data[next_i] is not None:
            segments.append(fillet_data[next_i][2])

    if not segments:
        return None

    # Convert all to NurbsCurve and merge into one
    nurbs_segs = []
    for seg in segments:
        nc = seg.ToNurbsCurve()
        if nc:
            nurbs_segs.append(nc)

    if not nurbs_segs:
        return None

    # Join into a single closed NurbsCurve
    joined = rg.Curve.JoinCurves(nurbs_segs, sc.doc.ModelAbsoluteTolerance)
    if not joined:
        return None

    return joined[0]


def create_trapezoid_extrusions(ptA, ptB, height, angle_deg, half_depth,
                                 start_cap=False, end_cap=False, fillet_radius=0.0):
    seg_len = ptA.DistanceTo(ptB)
    inset = height / math.tan(math.radians(angle_deg))
    inset = min(inset, seg_len / 2.0)

    dir_vec = ptB - ptA
    dir_vec.Unitize()
    perp = rg.Vector3d.CrossProduct(dir_vec, rg.Vector3d(0, 0, 1))
    perp.Unitize()

    # Four corners: p0 (bottom-left), p1 (bottom-right), p2 (top-right), p3 (top-left)
    p0 = rg.Point3d(ptA)
    p1 = rg.Point3d(ptB)

    p2 = rg.Point3d(ptB)
    if not end_cap:
        p2 -= dir_vec * inset
    p2.Z += height

    p3 = rg.Point3d(ptA)
    if not start_cap:
        p3 += dir_vec * inset
    p3.Z += height

    # Fillet flags per corner:
    # p0 (bottom-left) : never
    # p1 (bottom-right): never
    # p2 (top-right)   : only when it's an 80deg inset (not an end cap vertical)
    # p3 (top-left)    : only when it's an 80deg inset (not a start cap vertical)
    fillet_flags = [False, False, not end_cap, not start_cap]

    profile = build_profile_curve([p0, p1, p2, p3], fillet_flags, fillet_radius)
    if not profile:
        return []

    brep_list = rg.Brep.CreatePlanarBreps(profile, sc.doc.ModelAbsoluteTolerance)
    if not brep_list:
        return []

    brep = brep_list[0]
    vec = perp * -half_depth * 2
    line_crv = rg.Line(p0, p0 + vec).ToNurbsCurve()
    extr = brep.Faces[0].CreateExtrusion(line_crv, True)

    return [extr] if extr else []


# MAIN
result = []
for crv in flatten_curves(Curves):
    if not isinstance(crv, rg.Curve):
        continue
    length = crv.GetLength()
    seg_count = max(1, int(math.floor(length / MinWidth)))
    params = crv.DivideByCount(seg_count, True)
    if not params or len(params) < 2:
        continue

    half_depth = Depth
    n = len(params) - 1
    for i in range(n):
        t0, t1 = params[i], params[i + 1]
        pA = crv.PointAt(t0)
        pB = crv.PointAt(t1)
        result.extend(
            create_trapezoid_extrusions(pA, pB, Height, 80, half_depth,
                                        i == 0, i == n - 1, FilletRadius)
        )

Breps = result
# ---------- end py3_3 ----------

# ----
# OUTPUTS
# The 3D objects are complete and ready to be baked
crenelations = Brep(py3_3.Breps)

stackedstone = Brep(extr)
mudbrick = Brep(extr_2)
